% Simulink data dictionary PMSM_sin_hf_vs.sldd

Tpwm = Simulink.Parameter(16000, DataType="uint16")
ialpha = Simulink.Signal(StorageClass="ExportedGlobal", DataType="single")
ibeta = Simulink.Signal(StorageClass="ExportedGlobal", DataType="single")
ualpha = Simulink.Signal(StorageClass="ExportedGlobal", DataType="single")
ubeta = Simulink.Signal(StorageClass="ExportedGlobal", DataType="single")
Ts = Simulink.Parameter(0.0001, DataType="single")
Udc = Simulink.Parameter(24, DataType="single")
state = Simulink.Signal(StorageClass="ExportedGlobal", DataType="single")
theta = Simulink.Signal(StorageClass="ExportedGlobal", DataType="single")
G1 = Simulink.Parameter(-4000, DataType="single")
G2 = Simulink.Parameter(14000, DataType="single")
LunTheta = Simulink.Signal(StorageClass="ExportedGlobal", DataType="single")
LunWm = Simulink.Signal(StorageClass="ExportedGlobal", DataType="single")
curr_d_ki = Simulink.Parameter(35, StorageClass="Struct", StructName="curr_kpki", DataType="single")
curr_d_kp = Simulink.Parameter(0.17, StorageClass="Struct", StructName="curr_kpki", DataType="single")
spd_kp = Simulink.Parameter(0.3389, StorageClass="Struct", StructName="spd_kpki", DataType="single")
spd_ki = Simulink.Parameter(0.0144, StorageClass="Struct", StructName="spd_kpki", DataType="single")
Pn = Simulink.Parameter(4, DataType="single")
L = Simulink.Parameter(0.00535, DataType="single")
Rs = Simulink.Parameter(6.97, DataType="single")
flux = Simulink.Parameter(0.016884, DataType="single")